% Requirement links of Transmitter.m (R2023b)

% line 4 relates to TransmitterRequirements.slreqx#1
    properties

% lines 5-6 implements TransmitterRequirements.slreqx#2
        % Carrier frequency (Hz).
        CarrierFrequency(1, 1) double {mustBeFinite, mustBePositive} = 6e5

% lines 7-8 implements TransmitterRequirements.slreqx#3
        % Upsampling rate (Hz).
        UpsamplingRate(1, 1) double {mustBeFinite, mustBePositive} = 2e6

% lines 9-11 implements TransmitterRequirements.slreqx#4
        % Upsampling method ("upsample"|"interp"|"resample").
        UpsamplingMethod(1, 1) string {mustBeMember( UpsamplingMethod, ...
            ["upsample", "interp", "resample"] )} = "resample"

% lines 16-27 implements TransmitterRequirements.slreqx#5
        function obj = Transmitter( namedArgs )

            arguments ( Input )
                namedArgs.?Transmitter
            end % arguments ( Input )

            namedArgs = namedargs2cell( namedArgs );
            for k = 1 : 2 : numel( namedArgs )
                obj.(namedArgs{k}) = namedArgs{k+1};
            end % for

        end % constructor

% lines 29-64 implements TransmitterRequirements.slreqx#6
        function tt = transmit( obj, tt )
            %TRANSMIT Transmit a signal.

            arguments ( Input )
                obj(1, 1) Transmitter
                tt(:, 1) timetable
            end % arguments ( Input )

            % Extract the signal name, times, values, and sample rate.
            name = tt.Properties.VariableNames;
            t = tt.Properties.RowTimes;
            w = tt{:, 1};
            fs = tt.Properties.SampleRate;

            % Upsample the signal.
            switch obj.UpsamplingMethod
                case "resample"
                    w = resample( w, obj.UpsamplingRate, fs );
                case {"upsample", "interp"}
                    upfactor = ceil( obj.UpsamplingRate / fs );
                    w = feval( obj.UpsamplingMethod, w, upfactor );
            end % switch/case

            % Create the new time base.
            Time = linspace( min( t ), max( t ), numel( w ) ).';

            % Create the new signal timetable.
            tt = timetable( Time );
            fs = tt.Properties.SampleRate;

            % Perform the modulation.
            w = modulate( w, obj.CarrierFrequency, fs, "am" );
            tt{:, 1} = w;
            tt.Properties.VariableNames = name;

        end % transmit