% Requirement links of tPulsedSineWave.m (R2023b)

% lines 36-64 verifies PulsedSineWaveRequirements.slreqx#12
        function tDefaultPSWIsCorrect(testCase)

            % Setup
            % expectedAmplitude = 1.1;
            % expectedFrequenct .....
            %
            % DefaultPSWProperties = struct( ...
            %     "Amplitude", 1.1, ...
            %     "Frequency", 1000, ...
            %     "Duration", 2, ...
            %     "PulseRate", 4, ...
            %     "Duty", 30, ...
            %     "SampleRate", 8000);

            % Execute
            %SUT = PulsedSineWave;

            % Qualify
            % props = string(fieldnames(testCase.DefaultPSWProperties))';
            % for p = props
            %     expected = testCase.DefaultPSWProperties.(p);
            %     verifyEqual(testCase, testCase.SUT.(p), ...
            %         expected, ...
            %         p, ...
            %         AbsTol = 30*eps(expected));
            % end % for
            checkPropertiesMatchDefaults(testCase);

        end % function tDefaultPSWIsCorrect

% lines 66-80 verifies PulsedSineWaveRequirements.slreqx#2
% lines 66-80 verifies PulsedSineWaveRequirements.slreqx#3
% lines 66-80 verifies PulsedSineWaveRequirements.slreqx#4
% lines 66-80 verifies PulsedSineWaveRequirements.slreqx#5
% lines 66-80 verifies PulsedSineWaveRequirements.slreqx#6
% lines 66-80 verifies PulsedSineWaveRequirements.slreqx#7
% lines 66-80 verifies PulsedSineWaveRequirements.slreqx#8
        function tChangingNumericPropertiesWorks(testCase, numericProperties)

            % Setup 
            %SUT = PulsedSineWave;
            expected = 2;

            % Execute
            testCase.SUT.(numericProperties) = expected;

            % Qualify
            verifyEqual(testCase, testCase.SUT.(numericProperties), ...
                expected);
            checkPropertiesMatchDefaults(testCase, numericProperties)

        end % function tChangingAmplitudeWorks